% Simulink data dictionary P2319ASW01.sldd
% references Config.sldd

ASWIN_TqSpdCtrl = Simulink.Bus()
  ASWIN_McuReqDa: uint8[8]
  ASWIN_McuReqCt: uint8

ASWOUT_TqSpdCtrl = Simulink.Bus()
  ASWOUT_McuData1Da: uint8[8]

ASWIN_CurCtrl = Simulink.Bus()
  ASWIN_HvBusU: uint16
  ASWIN_PhaCurA: uint16
  ASWIN_PhaCurB: uint16
  ASWIN_PhaCurC: uint16
  ASWIN_EncoderCt: int16
  ASWIN_EncoderZ: boolean
  ASWIN_HvBusCur: uint16
  ASWIN_PhaUA: uint16
  ASWIN_PhaUB: uint16
  ASWIN_PhaUC: uint16
  ASWIN_ResolverSin: uint16
  ASWIN_ResolverCos: uint16

ASWOUT_CurCtrl = Simulink.Bus()
  ASWOUT_PhaAPwmDc: uint16
  ASWOUT_PhaBPwmDc: uint16
  ASWOUT_PhaCPwmDc: uint16

ASWIN_Supervisor = Simulink.Bus()
  ASWIN_MaiPwrSts: boolean
  ASWIN_AuxPwrSts: boolean
  ASWIN_BdT1: uint16
  ASWIN_BdT2: uint16
  ASWIN_McuT: uint16
  ASWIN_McuURef: uint16
  ASWIN_McuUBat: uint16

ASWOUT_Supervisor = Simulink.Bus()
  ASWOUT_GreenLed: boolean
  ASWOUT_RedLed: boolean
  ASWOUT_YellowLed: boolean
  ASWOUT_ResolverExctEna: boolean
  ASWOUT_McuData2Da: uint8[8]
  ASWOUT_CanPwrPwmEna: boolean
  ASWOUT_InPwrPwmEna: boolean
  ASWOUT_MtrPwrPwmEna: boolean
  ASWOUT_SwPwrPwmEna: boolean
  ASWOUT_PhaPwmEna: boolean