% Simulink data dictionary Config.sldd

DRIVEMODE = enum(DefaultValue="DISABLED", StorageType="uint8")
  DISABLED = 0
  TQ_CTRL = 1
  SPD_CTRL = 2
  OPEN_LOOP = 3

SharedConfig = Simulink.ConfigSet(StartTime="0", StopTime="10", Solver="FixedStepAuto", ProdHWDeviceType="NXP->Cortex-M4", SystemTargetFile="ert.tlc", TargetLang="C")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
TRIG_TYPE = Simulink.NumericType(DataTypeMode="Single", SignednessBool=true, WordLength=32, FixedExponent=0)
SPD_TYPE = Simulink.NumericType(DataTypeMode="Single", SignednessBool=true, WordLength=32, FixedExponent=0)

TIME_TYPE = Simulink.NumericType(DataTypeMode="Single", SignednessBool=true, WordLength=32, FixedExponent=0)  % Range: [63,-64]
  % Precision: 0.0298 us

VOLT_TYPE = Simulink.NumericType(DataTypeMode="Single", SignednessBool=true, WordLength=32, FixedExponent=0)
CURRENT_TYPE = Simulink.NumericType(DataTypeMode="Single", SignednessBool=true, WordLength=32, FixedExponent=0)
PCNT_TYPE = Simulink.NumericType(DataTypeMode="Single", SignednessBool=true, WordLength=32, FixedExponent=0)
TEMP_TYPE = Simulink.NumericType(DataTypeMode="Single", SignednessBool=true, WordLength=32, FixedExponent=0)