% Simulink data dictionary ADCINP.sldd
% references Config.sldd

ASWIN_HvBusCur = Simulink.Signal(StorageClass="ExportedGlobal", DataType="uint16", Unit="1")  % The raw ADC input value
ASWIN_HvBusU = Simulink.Signal(StorageClass="ExportedGlobal", DataType="uint16", Unit="1")  % The raw ADC input value
HvBusCur = Simulink.Signal(StorageClass="ExportedGlobal", DataType="CURRENT_TYPE", Unit="A")  % The DC bus current into the inverter
HvBusCurDialVal_C = CustomStorageClasses.Parameter(0, StorageClass="Calibration", DataType="CURRENT_TYPE", Min=-1000, Max=1000, Unit="A")  % Signal override value
HvBusCurGain_C = CustomStorageClasses.Parameter(0.001548, StorageClass="Calibration", DataType="single", Min=-1000, Max=1000, Unit="A/1")  % Gain to convert raw input to engineering units
DT_ADCINP_C = CustomStorageClasses.Parameter(0.0001, DataType="single", Min=9.0e-5, Max=0.00011, Unit="s")  % SWU sample time
HvBusU = Simulink.Signal(StorageClass="ExportedGlobal", DataType="VOLT_TYPE", Unit="V")  % The DC bus voltage into the inverter
HvBusUDialVal_C = CustomStorageClasses.Parameter(0, StorageClass="Calibration", DataType="VOLT_TYPE", Min=0, Max=1000, Unit="V")  % Signal override value
HvBusUGain_C = CustomStorageClasses.Parameter(0.0152, StorageClass="Calibration", DataType="single", Min=-1000, Max=1000, Unit="V/1")  % Gain to convert raw input to engineering units
HvBusUOfs_C = CustomStorageClasses.Parameter(0, StorageClass="Calibration", DataType="VOLT_TYPE", Min=-1000, Max=1000, Unit="V")  % Offset to convert raw input to engineering units
HvBusCurOfs_C = CustomStorageClasses.Parameter(0, StorageClass="Calibration", DataType="CURRENT_TYPE", Min=-1000, Max=1000, Unit="A")  % Offset to convert raw input to engineering units
PhaCurA = Simulink.Signal(StorageClass="ExportedGlobal", DataType="CURRENT_TYPE", Unit="A")  % Phase A current
PhaCurADialVal_C = CustomStorageClasses.Parameter(0, StorageClass="Calibration", DataType="CURRENT_TYPE", Min=-1000, Max=1000, Unit="A")  % Signal override value
PhaCurAGain_C = CustomStorageClasses.Parameter(0.001548, StorageClass="Calibration", DataType="single", Min=-1000, Max=1000, Unit="A/1")  % Gain to convert raw input to engineering units
PhaCurAOfs_C = CustomStorageClasses.Parameter(-3.06, StorageClass="Calibration", DataType="CURRENT_TYPE", Min=-1000, Max=1000, Unit="A")  % Offset to convert raw input to engineering units
PhaCurB = Simulink.Signal(StorageClass="ExportedGlobal", DataType="CURRENT_TYPE", Unit="A")  % Phase B current
PhaCurBDialVal_C = CustomStorageClasses.Parameter(0, StorageClass="Calibration", DataType="CURRENT_TYPE", Min=-1000, Max=1000, Unit="A")  % Signal override value
PhaCurBGain_C = CustomStorageClasses.Parameter(0.001548, StorageClass="Calibration", DataType="single", Min=-1000, Max=1000, Unit="A/1")  % Gain to convert raw input to engineering units
PhaCurBOfs_C = CustomStorageClasses.Parameter(-3.06, StorageClass="Calibration", DataType="CURRENT_TYPE", Min=-1000, Max=1000, Unit="A")  % Offset to convert raw input to engineering units
PhaCurC = Simulink.Signal(StorageClass="ExportedGlobal", DataType="CURRENT_TYPE", Unit="A")  % Phase C current
PhaCurCDialVal_C = CustomStorageClasses.Parameter(0, StorageClass="Calibration", DataType="CURRENT_TYPE", Min=-1000, Max=1000, Unit="A")  % Signal override value
PhaCurCGain_C = CustomStorageClasses.Parameter(0.001548, StorageClass="Calibration", DataType="single", Min=-1000, Max=1000, Unit="A/1")  % Gain to convert raw input to engineering units
PhaCurCOfs_C = CustomStorageClasses.Parameter(-3.06, StorageClass="Calibration", DataType="CURRENT_TYPE", Min=-1000, Max=1000, Unit="A")  % Offset to convert raw input to engineering units
PhaUA = Simulink.Signal(StorageClass="ExportedGlobal", DataType="VOLT_TYPE", Unit="V")  % Phase A voltage
PhaUAGain_C = CustomStorageClasses.Parameter(0.0152, StorageClass="Calibration", DataType="single", Min=-1000, Max=1000, Unit="V/1")  % Gain to convert raw input to engineering units
PhaUAOfs_C = CustomStorageClasses.Parameter(0, StorageClass="Calibration", DataType="VOLT_TYPE", Min=-1000, Max=1000, Unit="V")  % Offset to convert raw input to engineering units
PhaUB = Simulink.Signal(StorageClass="ExportedGlobal", DataType="VOLT_TYPE", Unit="V")  % Phase B voltage
PhaUBGain_C = CustomStorageClasses.Parameter(0.0152, StorageClass="Calibration", DataType="single", Min=-1000, Max=1000, Unit="V/1")  % Gain to convert raw input to engineering units
PhaUBOfs_C = CustomStorageClasses.Parameter(0, StorageClass="Calibration", DataType="VOLT_TYPE", Min=-1000, Max=1000, Unit="V")  % Offset to convert raw input to engineering units
PhaUC = Simulink.Signal(StorageClass="ExportedGlobal", DataType="VOLT_TYPE", Unit="V")  % Phase C voltage
PhaUCGain_C = CustomStorageClasses.Parameter(0.0152, StorageClass="Calibration", DataType="single", Min=-1000, Max=1000, Unit="V/1")  % Gain to convert raw input to engineering units
PhaUCOfs_C = CustomStorageClasses.Parameter(0, StorageClass="Calibration", DataType="VOLT_TYPE", Min=-1000, Max=1000, Unit="V")  % Offset to convert raw input to engineering units
ASWIN_PhaCurA = Simulink.Signal(StorageClass="ExportedGlobal", DataType="uint16", Unit="1")  % The raw ADC input value
ASWIN_PhaCurB = Simulink.Signal(StorageClass="ExportedGlobal", DataType="uint16", Unit="1")  % The raw ADC input value
ASWIN_PhaCurC = Simulink.Signal(StorageClass="ExportedGlobal", DataType="uint16", Unit="1")  % The raw ADC input value
ASWIN_PhaUA = Simulink.Signal(StorageClass="ExportedGlobal", DataType="uint16", Unit="1")  % The raw ADC input value
ASWIN_PhaUB = Simulink.Signal(StorageClass="ExportedGlobal", DataType="uint16", Unit="1")  % The raw ADC input value
ASWIN_PhaUC = Simulink.Signal(StorageClass="ExportedGlobal", DataType="uint16", Unit="1")  % The raw ADC input value
ASWIN_ResolverSin = Simulink.Signal(StorageClass="ExportedGlobal", DataType="uint16", Unit="1")  % The raw ADC input value
ASWIN_ResolverCos = Simulink.Signal(StorageClass="ExportedGlobal", DataType="uint16", Unit="1")  % The raw ADC input value
ResolverSinGain_C = CustomStorageClasses.Parameter(0, StorageClass="Calibration", DataType="single", Min=-1000, Max=1000, Unit="1")  % Gain to convert raw input to engineering units
ResolverSinOfs_C = CustomStorageClasses.Parameter(0, StorageClass="Calibration", DataType="single", Min=-1000, Max=1000, Unit="1")  % Offset to convert raw input to engineering units
ResolverCosGain_C = CustomStorageClasses.Parameter(0, StorageClass="Calibration", DataType="single", Min=-1000, Max=1000, Unit="1")  % Gain to convert raw input to engineering units
ResolverCosOfs_C = CustomStorageClasses.Parameter(0, StorageClass="Calibration", DataType="single", Min=-1000, Max=1000, Unit="1")  % Offset to convert raw input to engineering units
ResolverSinCos = Simulink.Signal(StorageClass="ExportedGlobal", DataType="single", Unit="1")  % Resolver sine and cosine signals.
ResolverSinCosDialVal_CA = CustomStorageClasses.Parameter([0 1], StorageClass="Calibration", DataType="single", Min=-1, Max=1, Unit="1")  % Signal override value
HvBusCurDialEna_C = CustomStorageClasses.Parameter(1, StorageClass="Calibration", DataType="boolean", Min=0, Max=1, Unit="1")  % Signal override enable
HvBusUDialEna_C = CustomStorageClasses.Parameter(1, StorageClass="Calibration", DataType="boolean", Min=0, Max=1, Unit="1")  % Signal override enable
PhaCurADialEna_C = CustomStorageClasses.Parameter(1, StorageClass="Calibration", DataType="boolean", Min=0, Max=1, Unit="1")  % Signal override enable
PhaCurBDialEna_C = CustomStorageClasses.Parameter(1, StorageClass="Calibration", DataType="boolean", Min=0, Max=1, Unit="1")  % Signal override enable
PhaCurCDialEna_C = CustomStorageClasses.Parameter(1, StorageClass="Calibration", DataType="boolean", Min=0, Max=1, Unit="1")  % Signal override enable
ResolverSinCosDialEna_C = CustomStorageClasses.Parameter(1, StorageClass="Calibration", DataType="boolean", Min=0, Max=1, Unit="1")  % Signal override enable
HvBusCurFilTiCon_C = CustomStorageClasses.Parameter(0, StorageClass="Calibration", DataType="single", Min=0, Max=10, Unit="s")  % Low pass filter time constant for signal input processing
HvBusUFilTiCon_C = CustomStorageClasses.Parameter(0, StorageClass="Calibration", DataType="single", Min=0, Max=10, Unit="s")  % Low pass filter time constant for signal input processing
PhaCurAFilTiCon_C = CustomStorageClasses.Parameter(0, StorageClass="Calibration", DataType="single", Min=0, Max=10, Unit="s")  % Low pass filter time constant for signal input processing
PhaCurBFilTiCon_C = CustomStorageClasses.Parameter(0, StorageClass="Calibration", DataType="single", Min=0, Max=10, Unit="s")  % Low pass filter time constant for signal input processing
PhaCurCFilTiCon_C = CustomStorageClasses.Parameter(0, StorageClass="Calibration", DataType="single", Min=0, Max=10, Unit="s")  % Low pass filter time constant for signal input processing
PhaUAFilTiCon_C = CustomStorageClasses.Parameter(0, StorageClass="Calibration", DataType="single", Min=0, Max=10, Unit="s")  % Low pass filter time constant for signal input processing
PhaUBFilTiCon_C = CustomStorageClasses.Parameter(0, StorageClass="Calibration", DataType="single", Min=0, Max=10, Unit="s")  % Low pass filter time constant for signal input processing
PhaUCFilTiCon_C = CustomStorageClasses.Parameter(0, StorageClass="Calibration", DataType="single", Min=0, Max=10, Unit="s")  % Low pass filter time constant for signal input processing
ResolverSinFilTiCon_C = CustomStorageClasses.Parameter(0, StorageClass="Calibration", DataType="single", Min=0, Max=10, Unit="s")  % Low pass filter time constant for signal input processing
ResolverCosFilTiCon_C = CustomStorageClasses.Parameter(0, StorageClass="Calibration", DataType="single", Min=0, Max=10, Unit="s")  % Low pass filter time constant for signal input processing