% Simulink data dictionary CLAPAR.sldd
% references Config.sldd

PhaCurD = Simulink.Signal(StorageClass="ExportedGlobal", DataType="CURRENT_TYPE", Unit="A")  % The motor current in the rotating d axis direction (non-torque producing).
PhaCurDDialEna_C = CustomStorageClasses.Parameter(0, StorageClass="Calibration", DataType="boolean", Min=0, Max=1, Unit="1")  % Signal override enable
PhaCurDDialVal_C = CustomStorageClasses.Parameter(0, StorageClass="Calibration", DataType="CURRENT_TYPE", Min=-1000, Max=1000, Unit="A")  % Signal override value
PhaCurQ = Simulink.Signal(StorageClass="ExportedGlobal", DataType="CURRENT_TYPE", Unit="A")  % The motor current in the rotating q axis direction (torque producing).
PhaCurQDialEna_C = CustomStorageClasses.Parameter(0, StorageClass="Calibration", DataType="boolean", Min=0, Max=1, Unit="1")  % Signal override enable
PhaCurQDialVal_C = CustomStorageClasses.Parameter(0, StorageClass="Calibration", DataType="CURRENT_TYPE", Min=-1000, Max=1000, Unit="A")  % Signal override value