% Simulink data dictionary CURCTL.sldd
% references Config.sldd

DT_CURCTL_C = CustomStorageClasses.Parameter(0.0001, DataType="single", Min=9.0e-5, Max=0.00011, Unit="s")  % SWU sample time
FluxLinkage_C = CustomStorageClasses.Parameter(0.011, StorageClass="Calibration", DataType="single", Min=0, Max=10, Unit="V*s")  % The permanent magnet flux linkage of the motor
PhaUDAntiWindupGain_C = CustomStorageClasses.Parameter(25, StorageClass="Calibration", DataType="single", Unit="1/V")  % Gain used to attenuate the integrated error when the output voltage command is saturated to avoid integral windup
PhaUDCmd = Simulink.Signal(StorageClass="ExportedGlobal", DataType="VOLT_TYPE", Unit="V")  % Commanded d-axis phase voltage
PhaUDCmdDialEna_C = CustomStorageClasses.Parameter(0, StorageClass="Calibration", DataType="boolean", Min=0, Max=1, Unit="1")  % Signal override enable
PhaUDCmdDialVal_C = CustomStorageClasses.Parameter(0, StorageClass="Calibration", DataType="VOLT_TYPE", Min=-1000, Max=1000, Unit="V")  % Signal override value
PhaUDCmdOpenLoop_C = CustomStorageClasses.Parameter(0, StorageClass="Calibration", DataType="VOLT_TYPE", Min=-10000, Max=10000, Unit="V")  % The d-axis phase voltage command in open loop mode
PhaUDGainI_C = CustomStorageClasses.Parameter(50, StorageClass="Calibration", DataType="single", Min=-10000, Max=10000, Unit="V/(A*s)")  % Integral control gain for d-axis current control
PhaUDGainP_C = CustomStorageClasses.Parameter(0.5, StorageClass="Calibration", DataType="single", Min=-10000, Max=10000, Unit="V/A")  % Proportional control gain for d-axis current control
PhaUMaxVal_C = CustomStorageClasses.Parameter(12, StorageClass="Calibration", DataType="VOLT_TYPE", Unit="V")  % The smallest value the maximum phase voltage is allowed to take on for current control calculations
PhaUQAntiWindupGain_C = CustomStorageClasses.Parameter(25, StorageClass="Calibration", DataType="single", Unit="1/V")  % Gain used to attenuate the integrated error when the output voltage command is saturated to avoid integral windup
PhaUQCmd = Simulink.Signal(StorageClass="ExportedGlobal", DataType="VOLT_TYPE", Unit="V")  % Commanded q-axis phase voltage
PhaUQCmdDialEna_C = CustomStorageClasses.Parameter(0, StorageClass="Calibration", DataType="boolean", Min=0, Max=1, Unit="1")  % Signal override enable
PhaUQCmdDialVal_C = CustomStorageClasses.Parameter(0, StorageClass="Calibration", DataType="VOLT_TYPE", Min=-1000, Max=1000, Unit="V")  % Signal override value
PhaUQCmdOpenLoop_C = CustomStorageClasses.Parameter(2, StorageClass="Calibration", DataType="VOLT_TYPE", Min=-10000, Max=10000, Unit="V")  % The q-axis phase voltage command in open loop mode
PhaUQGainI_C = CustomStorageClasses.Parameter(50, StorageClass="Calibration", DataType="single", Min=-10000, Max=10000, Unit="V/(A*s)")  % Integral control gain for q-axis current control
PhaUQGainP_C = CustomStorageClasses.Parameter(0.5, StorageClass="Calibration", DataType="single", Min=-10000, Max=10000, Unit="V/A")  % Proportional control gain for q-axis current control
StatorInductanceD_C = CustomStorageClasses.Parameter(0.00018, StorageClass="Calibration", DataType="single", Min=0, Max=10, Unit="H")  % The motor stator d-axis inductance
StatorInductanceQ_C = CustomStorageClasses.Parameter(0.00018, StorageClass="Calibration", DataType="single", Min=0, Max=10, Unit="H")  % The motor stator q-axis inductance