% Simulink data dictionary GATOUP.sldd
% references Config.sldd

ASWOUT_PhaAPwmDc = Simulink.Signal(StorageClass="ExportedGlobal", DataType="uint16", Unit="1")  % The raw modulation command used by the hardware PWM generator
ASWOUT_PhaBPwmDc = Simulink.Signal(StorageClass="ExportedGlobal", DataType="uint16", Unit="1")  % The raw modulation command used by the hardware PWM generator
ASWOUT_PhaCPwmDc = Simulink.Signal(StorageClass="ExportedGlobal", DataType="uint16", Unit="1")  % The raw modulation command used by the hardware PWM generator
PhaAPwmDcDialEna_C = CustomStorageClasses.Parameter(0, StorageClass="Calibration", DataType="boolean", Min=0, Max=1, Unit="1")  % Signal override enable
PhaAPwmDcDialVal_C = CustomStorageClasses.Parameter(1000, StorageClass="Calibration", DataType="uint16", Min=0, Max=65000, Unit="1")  % Signal override value
PhaBPwmDcDialEna_C = CustomStorageClasses.Parameter(0, StorageClass="Calibration", DataType="boolean", Min=0, Max=1, Unit="1")  % Signal override enable
PhaBPwmDcDialVal_C = CustomStorageClasses.Parameter(1000, StorageClass="Calibration", DataType="uint16", Min=0, Max=65000, Unit="1")  % Signal override value
PhaCPwmDcDialEna_C = CustomStorageClasses.Parameter(0, StorageClass="Calibration", DataType="boolean", Min=0, Max=1, Unit="1")  % Signal override enable
PhaCPwmDcDialVal_C = CustomStorageClasses.Parameter(600, StorageClass="Calibration", DataType="uint16", Min=0, Max=65000, Unit="1")  % Signal override value
ReloadRegisterMax_C = CustomStorageClasses.Parameter(12000, StorageClass="Calibration", DataType="int16", Min=0, Max=32500, Unit="1")  % The maximum value of the register used by the hardware PWM generator