% Simulink data dictionary INVCPA.sldd
% references Config.sldd

PhaUACmd = Simulink.Signal(StorageClass="ExportedGlobal", DataType="VOLT_TYPE", Unit="V")  % Phase A voltage command
PhaUACmdDialEna_C = CustomStorageClasses.Parameter(0, StorageClass="Calibration", DataType="boolean", Min=0, Max=1, Unit="1")  % Signal override enable
PhaUACmdDialVal_C = CustomStorageClasses.Parameter(0, StorageClass="Calibration", DataType="VOLT_TYPE", Min=-1000, Max=1000, Unit="V")  % Signal override value
PhaUBCmd = Simulink.Signal(StorageClass="ExportedGlobal", DataType="VOLT_TYPE", Unit="V")  % Phase B voltage command
PhaUBCmdDialEna_C = CustomStorageClasses.Parameter(0, StorageClass="Calibration", DataType="boolean", Min=0, Max=1, Unit="1")  % Signal override enable
PhaUBCmdDialVal_C = CustomStorageClasses.Parameter(0, StorageClass="Calibration", DataType="VOLT_TYPE", Min=-1000, Max=1000, Unit="V")  % Signal override value
PhaUCCmd = Simulink.Signal(StorageClass="ExportedGlobal", DataType="VOLT_TYPE", Unit="V")  % Phase C voltage command
PhaUCCmdDialEna_C = CustomStorageClasses.Parameter(0, StorageClass="Calibration", DataType="boolean", Min=0, Max=1, Unit="1")  % Signal override enable
PhaUCCmdDialVal_C = CustomStorageClasses.Parameter(0, StorageClass="Calibration", DataType="VOLT_TYPE", Min=-1000, Max=1000, Unit="V")  % Signal override value