% Simulink data dictionary MEDINP.sldd
% references Config.sldd

ASWIN_McuReqCt = Simulink.Signal(StorageClass="ExportedGlobal", DataType="uint8", Unit="1")  % The raw message counter used to indicate message freshness
DrvModReq = Simulink.Signal(StorageClass="ExportedGlobal", DataType="Enum: DRIVEMODE", Unit="1")  % The requested drive mode
DrvModReqDft_C = CustomStorageClasses.Parameter(Simulink.data.Expression(ExpressionString="DRIVEMODE.DISABLED"), StorageClass="Calibration", DataType="Enum: DRIVEMODE", Unit="1")  % The default value used for this signal when the message has timedout
DrvModReqDialVal_C = CustomStorageClasses.Parameter(Simulink.data.Expression(ExpressionString="DRIVEMODE.DISABLED"), StorageClass="Calibration", DataType="Enum: DRIVEMODE", Unit="1")  % Signal override value
DT_MEDINP_C = CustomStorageClasses.Parameter(0.01, DataType="single", Min=0.009, Max=0.011, Unit="s")  % SWU sample time
McuReqTout_C = CustomStorageClasses.Parameter(0.07, StorageClass="Calibration", DataType="single", Min=0, Max=10, Unit="s")  % Timeout time for the MCUReq message
MotSpdReqCan = Simulink.Signal(StorageClass="ExportedGlobal", DataType="int16", Unit="rpm")  % The requested motor speed
MotSpdReqCanDft_C = CustomStorageClasses.Parameter(0, StorageClass="Calibration", DataType="int16", Min=-32000, Max=32000, Unit="rpm")  % The default value used for this signal when the message has timedout
MotSpdReqCanDialVal_C = CustomStorageClasses.Parameter(0, StorageClass="Calibration", DataType="int16", Min=-32000, Max=32000, Unit="rpm")  % Signal override value
MotTqReqCan = Simulink.Signal(StorageClass="ExportedGlobal", DataType="single", Unit="N*m")  % The requested motor torque
MotTqReqCanDft_C = CustomStorageClasses.Parameter(0, StorageClass="Calibration", DataType="single", Min=-10000, Max=10000, Unit="N*m")  % The default value used for this signal when the message has timedout
MotTqReqCanDialVal_C = CustomStorageClasses.Parameter(0, StorageClass="Calibration", DataType="single", Min=-10000, Max=10000, Unit="N*m")  % Signal override value
ASWIN_McuReqDa = Simulink.Signal(StorageClass="ExportedGlobal", DataType="uint8", Unit="1")  % The raw message data frame
DrvModReqDialEna_C = CustomStorageClasses.Parameter(1, StorageClass="Calibration", DataType="boolean", Min=0, Max=1, Unit="1")  % Signal override enable
MotTqReqCanDialEna_C = CustomStorageClasses.Parameter(1, StorageClass="Calibration", DataType="boolean", Min=0, Max=1, Unit="1")  % Signal override enable
MotSpdReqCanDialEna_C = CustomStorageClasses.Parameter(1, StorageClass="Calibration", DataType="boolean", Min=0, Max=1, Unit="1")  % Signal override enable