% Simulink data dictionary MEDOUP.sldd
% references Config.sldd

McuData1DaDialEna_C = CustomStorageClasses.Parameter(0, StorageClass="Calibration", DataType="boolean", Min=0, Max=1, Unit="1")  % Signal override enable
McuData1DaDialVal_CA = CustomStorageClasses.Parameter(repmat(0, 1, 8), StorageClass="Calibration", DataType="uint8", Min=0, Max=255, Unit="1")  % Signal override value
ASWOUT_McuData1Da = Simulink.Signal(StorageClass="ExportedGlobal", DataType="uint8", Unit="1")  % The raw message data frame