% Simulink data dictionary MODCTL.sldd
% references Config.sldd

DrvMod = Simulink.Signal(StorageClass="ExportedGlobal", DataType="Enum: DRIVEMODE", Unit="1")  % The active drive mode
DT_MODCTL_C = CustomStorageClasses.Parameter(0.1, DataType="single", Min=0.09, Max=0.11, Unit="s")  % SWU sample time
MotSpdReqThdModChg_C = CustomStorageClasses.Parameter(50, StorageClass="Calibration", DataType="uint16", Min=0, Max=50000, Unit="rpm")  % The motor speed request below which the drive is allowed to change modes
MotSpdThdModChg_C = CustomStorageClasses.Parameter(50, StorageClass="Calibration", DataType="uint16", Min=0, Max=50000, Unit="rpm")  % The motor speed below which the drive is allowed to change modes
MotTqReqThdModChg_C = CustomStorageClasses.Parameter(1, StorageClass="Calibration", DataType="single", Min=0, Max=10000, Unit="N*m")  % The motor torque request below which the drive is allowed to change modes
PwrCmd = Simulink.Signal(StorageClass="ExportedGlobal", DataType="boolean", Unit="1")  % The command to activate the auxilary power supplies
PwrCmdDialVal_C = CustomStorageClasses.Parameter(0, StorageClass="Calibration", DataType="boolean", Min=0, Max=1, Unit="1")  % Signal override value
WakeRetry_C = CustomStorageClasses.Parameter(0, StorageClass="Calibration", DataType="boolean", Min=0, Max=1, Unit="1")  % Flag used to force the drive to try and rewake the board by activiting the power command
WakeTout_C = CustomStorageClasses.Parameter(1, StorageClass="Calibration", DataType="single", Min=0, Max=60, Unit="s")  % The amount of time the control waits for the power activation signal before shutting off the power command and terminating the wake attempt
DrvModDialVal_C = CustomStorageClasses.Parameter(Simulink.data.Expression(ExpressionString="DRIVEMODE.DISABLED"), StorageClass="Calibration", DataType="Enum: DRIVEMODE", Unit="1")  % Signal override value
DrvModDialEna_C = CustomStorageClasses.Parameter(1, StorageClass="Calibration", DataType="boolean", Min=0, Max=1, Unit="1")  % Signal override enable
PwrCmdDialEna_C = CustomStorageClasses.Parameter(1, StorageClass="Calibration", DataType="boolean", Min=0, Max=1, Unit="1")  % Signal override enable