% Simulink data dictionary POSINP.sldd
% references Config.sldd

ASWIN_EncoderZ = Simulink.Signal(StorageClass="ExportedGlobal", DataType="boolean", Unit="1")  % The raw encoder z signal
ASWIN_EncoderCt = Simulink.Signal(StorageClass="ExportedGlobal", DataType="int16", Unit="1")  % The raw encoder count input
EncoderCtPerRev_C = CustomStorageClasses.Parameter(1000, StorageClass="Calibration", DataType="uint16", Min=0, Max=65000, Unit="1")  % The number of encoder counts per mechanical revolution
EncoderOfs_C = CustomStorageClasses.Parameter(0, StorageClass="Calibration", DataType="TRIG_TYPE", Min=-6, Max=6, Unit="rad")  % Offset used to align the encoder z signal with the true zero angle
MotPolePairs_C = CustomStorageClasses.Parameter(4, StorageClass="Calibration", DataType="uint8", Min=1, Max=100, Unit="1")  % The number of pole pairs in the motor
MotPosnMag = Simulink.Signal(StorageClass="ExportedGlobal", DataType="TRIG_TYPE", Unit="rad")  % The magnetic rotor position. Zero degrees represents the rotor magnetic field aligned with the stator's A phase.
MotPosnMagDialVal_C = CustomStorageClasses.Parameter(0, StorageClass="Calibration", DataType="TRIG_TYPE", Min=0, Max=6.2831, Unit="rad")  % Signal override value
MotPosnMagMeasd = Simulink.Signal(StorageClass="ExportedGlobal", DataType="TRIG_TYPE", Unit="rad")  % The measured magnetic motor position. Can be used in open loop control to verify position measurement.
MotSpd = Simulink.Signal(StorageClass="ExportedGlobal", DataType="int16", Unit="rpm")  % The mechanical motor speed
MotSpdDialVal_C = CustomStorageClasses.Parameter(0, StorageClass="Calibration", DataType="int16", Min=-32000, Max=32000, Unit="rpm")  % Signal override value
MotSpdMag = Simulink.Signal(StorageClass="ExportedGlobal", DataType="SPD_TYPE", Unit="rad/s")  % The magnetic motor speed
MotSpdMagDialVal_C = CustomStorageClasses.Parameter(0, StorageClass="Calibration", DataType="SPD_TYPE", Min=-100000, Max=100000, Unit="rad/s")  % Signal override value
MotSpdFilTiCon_C = CustomStorageClasses.Parameter(0.001, StorageClass="Calibration", DataType="single", Min=0, Max=10, Unit="s")  % Low pass filter time constant for this signal
MotPosnErr = Simulink.Signal(StorageClass="ExportedGlobal", DataType="single", Unit="rad")  % Motor position error.
MotPosnEstimrGainI_C = CustomStorageClasses.Parameter(0, StorageClass="Calibration", DataType="single", Min=0, Max=1000000, Unit="1/s^2")  % Integral gain for MotPosn estimator.
MotPosnEstimrGainP_C = CustomStorageClasses.Parameter(0, StorageClass="Calibration", DataType="single", Min=0, Max=10000, Unit="1/s")  % Proportional gain for MotPosn estimator.
MotPosnEstimrIntglEna_C = CustomStorageClasses.Parameter(0, StorageClass="Calibration", DataType="boolean", Min=0, Max=1, Unit="1")  % MotPosn estimator integral enable: 0 = disable, 1 = enable.
MotPosnOfs_C = CustomStorageClasses.Parameter(0, StorageClass="Calibration", DataType="single", Min=-6.2832, Max=6.2832, Unit="rad")  % Motor position offset.
MotPosnSenMeth_C = CustomStorageClasses.Parameter(1, StorageClass="Calibration", DataType="boolean", Min=0, Max=1, Unit="1")  % Motor position sensing method: 0 = encoder, 1 = resolver.
MotPosnMagDialEna_C = CustomStorageClasses.Parameter(1, StorageClass="Calibration", DataType="boolean", Min=0, Max=1, Unit="1")  % Signal override enable
MotSpdDialEna_C = CustomStorageClasses.Parameter(1, StorageClass="Calibration", DataType="boolean", Min=0, Max=1, Unit="1")  % Signal override enable
MotSpdMagDialEna_C = CustomStorageClasses.Parameter(1, StorageClass="Calibration", DataType="boolean", Min=0, Max=1, Unit="1")  % Signal override enable
DT_POSINP_C = CustomStorageClasses.Parameter(0.0001, DataType="single", Min=9.0e-5, Max=0.00011, Unit="s")  % SWU sample time