% Simulink data dictionary POSTRG.sldd
% references Config.sldd

MotPosnTrig = Simulink.Signal(StorageClass="ExportedGlobal", DataType="TRIG_TYPE", Unit="1")  % The results of the trig calculations that are used in the reference frame transforms
MotPosnTrigDialEna_C = CustomStorageClasses.Parameter(0, StorageClass="Calibration", DataType="boolean", Min=0, Max=1, Unit="1")  % Signal override enable
MotPosnTrigDialVal_CA = CustomStorageClasses.Parameter(repmat(0, 1, 6), StorageClass="Calibration", DataType="TRIG_TYPE", Min=-100, Max=100, Unit="1")  % Signal override value