% Simulink data dictionary SLWINP.sldd
% references Config.sldd

ASWIN_AuxPwrSts = Simulink.Signal(StorageClass="ExportedGlobal", DataType="boolean", Unit="1")  % The raw input value
ASWIN_BdT1 = Simulink.Signal(StorageClass="ExportedGlobal", DataType="uint16", Unit="1")  % The raw ADC input value
ASWIN_BdT2 = Simulink.Signal(StorageClass="ExportedGlobal", DataType="uint16", Unit="1")  % The raw ADC input value
ASWIN_McuT = Simulink.Signal(StorageClass="ExportedGlobal", DataType="uint16", Unit="1")  % The raw ADC input value
AuxPwrStsIvt_C = CustomStorageClasses.Parameter(0, StorageClass="Calibration", DataType="boolean", Min=0, Max=1, Unit="1")  % Invert the auxilary power status input
AuxPwrAcv = Simulink.Signal(StorageClass="ExportedGlobal", DataType="boolean", Unit="1")  % Auxilary power active flag
AuxPwrAcvDialVal_C = CustomStorageClasses.Parameter(0, StorageClass="Calibration", DataType="boolean", Min=0, Max=1, Unit="1")  % Signal override value
BdT1 = Simulink.Signal(StorageClass="ExportedGlobal", DataType="TEMP_TYPE", Unit="degC")  % Board temperature 1
BdT1DialVal_C = CustomStorageClasses.Parameter(0, StorageClass="Calibration", DataType="TEMP_TYPE", Min=-40, Max=250, Unit="degC")  % Signal override value
BdT1Gain_C = CustomStorageClasses.Parameter(1, StorageClass="Calibration", DataType="single", Min=-1000, Max=1000, Unit="degC/1")  % Gain to convert raw input to engineering units
BdT1Ofs_C = CustomStorageClasses.Parameter(0, StorageClass="Calibration", DataType="single", Min=-1000, Max=1000, Unit="degC")  % Offset to convert raw input to engineering units
BdT2 = Simulink.Signal(StorageClass="ExportedGlobal", DataType="TEMP_TYPE", Unit="degC")  % Board temperature 2
BdT2DialVal_C = CustomStorageClasses.Parameter(0, StorageClass="Calibration", DataType="TEMP_TYPE", Min=-40, Max=250, Unit="degC")  % Signal override value
BdT2Gain_C = CustomStorageClasses.Parameter(1, StorageClass="Calibration", DataType="single", Min=-1000, Max=1000, Unit="degC/1")  % Gain to convert raw input to engineering units
BdT2Ofs_C = CustomStorageClasses.Parameter(0, StorageClass="Calibration", DataType="TEMP_TYPE", Min=-40, Max=250, Unit="degC")  % Offset to convert raw input to engineering units
DT_SLWINP_C = CustomStorageClasses.Parameter(0.1, DataType="single", Min=0.09, Max=0.11, Unit="s")  % SWU sample time
MaiPwrStsIvt_C = CustomStorageClasses.Parameter(0, StorageClass="Calibration", DataType="boolean", Min=0, Max=1, Unit="1")  % Invert the main power status input
MaiPwrAcv = Simulink.Signal(StorageClass="ExportedGlobal", DataType="boolean", Unit="1")  % Main power active flag
MaiPwrAcvDialVal_C = CustomStorageClasses.Parameter(0, StorageClass="Calibration", DataType="boolean", Min=0, Max=1, Unit="1")  % Signal override value
McuT = Simulink.Signal(StorageClass="ExportedGlobal", DataType="TEMP_TYPE", Unit="degC")  % Microcontroller temperature
McuTDialVal_C = CustomStorageClasses.Parameter(0, StorageClass="Calibration", DataType="TEMP_TYPE", Min=-40, Max=250, Unit="degC")  % Signal override value
McuTOfs_C = CustomStorageClasses.Parameter(0, StorageClass="Calibration", DataType="single", Min=-1000, Max=1000, Unit="degC")  % Offset to convert raw input to engineering units
ASWIN_MaiPwrSts = Simulink.Signal(StorageClass="ExportedGlobal", DataType="boolean", Unit="1")  % The raw input value
AuxPwrAcvDialEna_C = CustomStorageClasses.Parameter(1, StorageClass="Calibration", DataType="boolean", Min=0, Max=1, Unit="1")  % Signal override enable
MaiPwrAcvDialEna_C = CustomStorageClasses.Parameter(1, StorageClass="Calibration", DataType="boolean", Min=0, Max=1, Unit="1")  % Signal override enable
MaiPwrAcvDebFall_C = CustomStorageClasses.Parameter(0, StorageClass="Calibration", DataType="single", Min=0, Max=60, Unit="s")  % Falling edge debounce time for input processing
MaiPwrAcvDebRisng_C = CustomStorageClasses.Parameter(0, StorageClass="Calibration", DataType="single", Min=0, Max=60, Unit="s")  % Rising edge debounce time for input processing
AuxPwrAcvDebFall_C = CustomStorageClasses.Parameter(0, StorageClass="Calibration", DataType="single", Min=0, Max=60, Unit="s")  % Falling edge debounce time for input processing
AuxPwrAcvDebRisng_C = CustomStorageClasses.Parameter(0, StorageClass="Calibration", DataType="single", Min=0, Max=60, Unit="s")  % Rising edge debounce time for input processing
BdT1DialEna_C = CustomStorageClasses.Parameter(1, StorageClass="Calibration", DataType="boolean", Min=0, Max=1, Unit="1")  % Signal override enable
BdT2DialEna_C = CustomStorageClasses.Parameter(1, StorageClass="Calibration", DataType="boolean", Min=0, Max=1, Unit="1")  % Signal override enable
BdT1FilTiCon_C = CustomStorageClasses.Parameter(0, StorageClass="Calibration", DataType="single", Min=0, Max=60, Unit="s")  % Low pass filter time constant for signal input processing
BdT2FilTiCon_C = CustomStorageClasses.Parameter(0, StorageClass="Calibration", DataType="single", Min=0, Max=60, Unit="s")  % Low pass filter time constant for signal input processing
McuUBatFilTiCon_C = CustomStorageClasses.Parameter(0, StorageClass="Calibration", DataType="single", Min=0, Max=60, Unit="s")  % Low pass filter time constant for signal input processing
McuTFilTiCon_C = CustomStorageClasses.Parameter(0, StorageClass="Calibration", DataType="single", Min=0, Max=60, Unit="s")  % Low pass filter time constant for signal input processing
McuTDialEna_C = CustomStorageClasses.Parameter(1, StorageClass="Calibration", DataType="boolean", Min=0, Max=1, Unit="1")  % Signal override enable
McuUBat = Simulink.Signal(StorageClass="ExportedGlobal", DataType="single", Unit="V")  % Microcontroller voltage VBAT
McuUBatOfs_C = CustomStorageClasses.Parameter(0, StorageClass="Calibration", DataType="single", Min=-1000, Max=1000, Unit="V")  % Offset to convert raw input to engineering units
ASWIN_McuUBat = Simulink.Signal(StorageClass="ExportedGlobal", DataType="uint16", Unit="1")  % The raw ADC input value
ASWIN_McuURef = Simulink.Signal(StorageClass="ExportedGlobal", DataType="uint16", Unit="1")  % The raw ADC input value
McuURef = Simulink.Signal(StorageClass="ExportedGlobal", DataType="single", Unit="V")  % Microcontroller voltage VREFINT
McuURefFilTiCon_C = CustomStorageClasses.Parameter(0, StorageClass="Calibration", DataType="single", Min=0, Max=60, Unit="s")  % Low pass filter time constant for signal input processing
McuURefOfs_C = CustomStorageClasses.Parameter(0, StorageClass="Calibration", DataType="single", Min=-1000, Max=1000, Unit="V")  % Offset to convert raw input to engineering units
McuURefGain_C = CustomStorageClasses.Parameter(0, StorageClass="Calibration", DataType="single", Min=-1000, Max=1000, Unit="V/1")  % Gain to convert raw input to engineering units
McuTGain_C = CustomStorageClasses.Parameter(0, StorageClass="Calibration", DataType="single", Min=-1000, Max=1000, Unit="degC/1")  % Gain to convert raw input to engineering units
McuUBatGain_C = CustomStorageClasses.Parameter(0.01173, StorageClass="Calibration", DataType="single", Min=-1000, Max=1000, Unit="V/1")  % Gain to convert raw input to engineering units