% Simulink data dictionary SLWOUP.sldd
% references Config.sldd

ASWOUT_GreenLed = Simulink.Signal(StorageClass="ExportedGlobal", DataType="boolean", Unit="1")  % The raw output value
ASWOUT_McuData2Da = Simulink.Signal(StorageClass="ExportedGlobal", DataType="uint8", Unit="1")  % The raw message data frame
ASWOUT_RedLed = Simulink.Signal(StorageClass="ExportedGlobal", DataType="boolean", Unit="1")  % The raw output value
GreenLedDialEna_C = CustomStorageClasses.Parameter(0, StorageClass="Calibration", DataType="boolean", Min=0, Max=1, Unit="1")  % Signal override enable
GreenLedDialVal_C = CustomStorageClasses.Parameter(0, StorageClass="Calibration", DataType="boolean", Min=0, Max=1, Unit="1")  % Signal override value
LedOffTi_C = CustomStorageClasses.Parameter(0.5, StorageClass="Calibration", DataType="single", Min=0, Max=60, Unit="s")  % The time the LED is off between pulse groups
LedPlsCtDft_C = CustomStorageClasses.Parameter(1, StorageClass="Calibration", DataType="uint8", Min=0, Max=255, Unit="1")  % The number of on pulses for the LED while in this mode
LedPlsCtOpenLoop_C = CustomStorageClasses.Parameter(2, StorageClass="Calibration", DataType="uint8", Min=0, Max=255, Unit="1")  % The number of on pulses for the LED while in this mode
LedPlsCtSpdCtl_C = CustomStorageClasses.Parameter(4, StorageClass="Calibration", DataType="uint8", Min=0, Max=255, Unit="1")  % The number of on pulses for the LED while in this mode
LedPlsCtTqCtl_C = CustomStorageClasses.Parameter(3, StorageClass="Calibration", DataType="uint8", Min=0, Max=255, Unit="1")  % The number of on pulses for the LED while in this mode
McuData2DaDialEna_C = CustomStorageClasses.Parameter(0, StorageClass="Calibration", DataType="boolean", Min=0, Max=1, Unit="1")  % Signal override enable
McuData2DaDialVal_CA = CustomStorageClasses.Parameter(repmat(0, 1, 8), StorageClass="Calibration", DataType="uint8", Min=0, Max=255, Unit="1")  % Signal override value
PlsOffTi_C = CustomStorageClasses.Parameter(0.2, StorageClass="Calibration", DataType="single", Min=0, Max=60, Unit="s")  % The time the LED is off between two pulses
PlsOnTi_C = CustomStorageClasses.Parameter(0.2, StorageClass="Calibration", DataType="single", Min=0, Max=60, Unit="s")  % The time the LED is on during a pulse
RedLedDialEna_C = CustomStorageClasses.Parameter(0, StorageClass="Calibration", DataType="boolean", Min=0, Max=1, Unit="1")  % Signal override enable
RedLedDialVal_C = CustomStorageClasses.Parameter(0, StorageClass="Calibration", DataType="boolean", Min=0, Max=1, Unit="1")  % Signal override value
ASWOUT_YellowLed = Simulink.Signal(StorageClass="ExportedGlobal", DataType="boolean", Unit="1")  % The raw output value
ASWOUT_ResolverExctEna = Simulink.Signal(StorageClass="ExportedGlobal", DataType="boolean", Unit="1")  % The raw output value
ResolverExctEna_C = CustomStorageClasses.Parameter(0, StorageClass="Calibration", DataType="boolean", Min=0, Max=1, Unit="1")  % Command to enable resolver excitation waveform generation: 0 = disable, 1 = enable.
ASWOUT_CanPwrPwmEna = Simulink.Signal(StorageClass="ExportedGlobal", DataType="boolean", Unit="1")  % The raw output value
ASWOUT_SwPwrPwmEna = Simulink.Signal(StorageClass="ExportedGlobal", DataType="boolean", Unit="1")  % The raw output value
ASWOUT_InPwrPwmEna = Simulink.Signal(StorageClass="ExportedGlobal", DataType="boolean", Unit="1")  % The raw output value
ASWOUT_MtrPwrPwmEna = Simulink.Signal(StorageClass="ExportedGlobal", DataType="boolean", Unit="1")  % The raw output value
ASWOUT_PhaPwmEna = Simulink.Signal(StorageClass="ExportedGlobal", DataType="boolean", Unit="1")  % The raw modulation enable command used by the hardware PWM generator: 0 = disable, 1 = enable.
DT_SLWOUP_C = CustomStorageClasses.Parameter(0.1, DataType="single", Min=0.09, Max=0.11, Unit="s")  % The SWU sample time
GreenLedIvt_C = CustomStorageClasses.Parameter(1, StorageClass="Calibration", DataType="boolean", Min=0, Max=1, Unit="1")  % Invert the LED command
RedLedIvt_C = CustomStorageClasses.Parameter(1, StorageClass="Calibration", DataType="boolean", Min=0, Max=1, Unit="1")  % Invert the LED command
YellowLedCmd_C = CustomStorageClasses.Parameter(1, StorageClass="Calibration", DataType="boolean", Min=0, Max=1, Unit="1")  % Yellow LED activation command.
MtrPwrPwmEna_C = CustomStorageClasses.Parameter(0, StorageClass="Calibration", DataType="boolean", Min=0, Max=1, Unit="1")  % Enable MtrPwr modulation output: 0 = disable, 1 = enable.
SwPwrPwmEna_C = CustomStorageClasses.Parameter(0, StorageClass="Calibration", DataType="boolean", Min=0, Max=1, Unit="1")  % Enable SwPwr modulation output: 0 = disable, 1 = enable.
InPwrPwmEna_C = CustomStorageClasses.Parameter(0, StorageClass="Calibration", DataType="boolean", Min=0, Max=1, Unit="1")  % Enable InPwr modulation output: 0 = disable, 1 = enable.
CanPwrPwmEna_C = CustomStorageClasses.Parameter(0, StorageClass="Calibration", DataType="boolean", Min=0, Max=1, Unit="1")  % Enable CanPwr modulation output: 0 = disable, 1 = enable.
PhaPwmEnaDialEna_C = CustomStorageClasses.Parameter(1, StorageClass="Calibration", DataType="boolean", Min=0, Max=1, Unit="1")  % Signal override enable
PhaPwmEnaDialVal_C = CustomStorageClasses.Parameter(0, StorageClass="Calibration", DataType="boolean", Min=0, Max=1, Unit="1")  % Signal override value