% Simulink data dictionary SPDCTL.sldd
% references Config.sldd

DT_SPDCTL_C = CustomStorageClasses.Parameter(0.01, DataType="single", Min=0.009, Max=0.011, Unit="sec")  % SWU sample time
MotSpdCmd = Simulink.Signal(StorageClass="ExportedGlobal", DataType="int16", Unit="rpm")  % The motor speed command the controller is controlling to
MotSpdRateLim_C = CustomStorageClasses.Parameter(1000, StorageClass="Calibration", DataType="single", Min=0, Max=1000000, Unit="rpm/sec")  % The maximum rate at which the motor speed command is allowed to change
MotSpdReqMax_C = CustomStorageClasses.Parameter(1000, StorageClass="Calibration", DataType="int16", Min=0, Max=32000, Unit="rpm")  % The maximum magnitued of the speed command the control will attempt to control to
MotTqCmdSpdCtl = Simulink.Signal(StorageClass="ExportedGlobal", DataType="single", Unit="N*m")  % The motor torque commanded by the motor speed controller
MotTqCmdSpdCtlDialEna_C = CustomStorageClasses.Parameter(0, StorageClass="Calibration", DataType="boolean", Min=0, Max=1, Unit="1")  % Signal override enable
MotTqCmdSpdCtlDialVal_C = CustomStorageClasses.Parameter(0, StorageClass="Calibration", DataType="single", Min=-10000, Max=10000, Unit="N*m")  % Signal override value
MotTqGainI_C = CustomStorageClasses.Parameter(0.0001, StorageClass="Calibration", DataType="single", Min=-1000, Max=1000, Unit="N*m/(rpm*sec)")  % Integral gain for motor speed control
MotTqGainP_C = CustomStorageClasses.Parameter(0.0001, StorageClass="Calibration", DataType="single", Min=-1000, Max=1000, Unit="N*m/rpm")  % Proportional gain for motor speed control