% Simulink data dictionary TRQCTL.sldd
% references Config.sldd

MotTqCmd = Simulink.Signal(StorageClass="ExportedGlobal", DataType="single", Unit="N*m")  % The commanded motor torque after arbitration and limitations
MotTqCon_C = CustomStorageClasses.Parameter(0.054, StorageClass="Calibration", DataType="single", Min=0, Max=1000, Unit="N*m/A")  % The motor constant that maps between current and torque
MotTqGainBdT1_Ax = CustomStorageClasses.Parameter([-40 40 50 60 70], StorageClass="Calibration", DataType="single", Min=-40, Max=250, Unit="degC")  % The axis for the table that maps between the board temperature and the gain that limits the maximum motor torque
MotTqGainBdT1_T = CustomStorageClasses.Parameter([1 1 0 0 0], StorageClass="Calibration", DataType="single", Min=0, Max=1, Unit="1")  % The table values for the table that maps between the board temperature and the gain that limits the maximum motor torque
MotTqGainBdT2_Ax = CustomStorageClasses.Parameter([-40 40 50 60 70], StorageClass="Calibration", DataType="single", Min=-40, Max=250, Unit="degC")  % The axis for the table that maps between the board temperature and the gain that limits the maximum motor torque
MotTqGainBdT2_T = CustomStorageClasses.Parameter([1 1 0 0 0], StorageClass="Calibration", DataType="single", Min=0, Max=1, Unit="1")  % The table values for the table that maps between the board temperature and the gain that limits the maximum motor torque
MotTqMax = Simulink.Signal(StorageClass="ExportedGlobal", DataType="single", Unit="N*m")  % The maximum motor torque after derates
MotTqMaxDialEna_C = CustomStorageClasses.Parameter(0, StorageClass="Calibration", DataType="boolean", Min=0, Max=1, Unit="1")  % Signal override enable
MotTqMaxDialVal_C = CustomStorageClasses.Parameter(0, StorageClass="Calibration", DataType="single", Min=0, Max=10000, Unit="N*m")  % Signal override value
MotTqMaxMotSpd_Ax = CustomStorageClasses.Parameter([0 1000 2000 3000 4000], StorageClass="Calibration", DataType="single", Min=0, Max=32000, Unit="rpm")  % The axis values for the table that maps between the motor speed and the maximum motor torque
MotTqMaxMotSpd_T = CustomStorageClasses.Parameter(repmat(1, 1, 5), StorageClass="Calibration", DataType="single", Min=0, Max=10000, Unit="N*m")  % The table values for the table that maps between the motor speed and the maximum motor torque
PhaCurDTar = Simulink.Signal(StorageClass="ExportedGlobal", DataType="CURRENT_TYPE", Unit="A")  % The target d-axis current
PhaCurDTarVal_C = CustomStorageClasses.Parameter(0, StorageClass="Calibration", DataType="CURRENT_TYPE", Min=-1000, Max=1000, Unit="A")  % Signal override value
PhaCurQTar = Simulink.Signal(StorageClass="ExportedGlobal", DataType="CURRENT_TYPE", Unit="A")  % The target q-axis current
PhaCurQTarDialVal_C = CustomStorageClasses.Parameter(0, StorageClass="Calibration", DataType="CURRENT_TYPE", Min=-1000, Max=1000, Unit="A")  % Signal override value
PhaCurQTarDialEna_C = CustomStorageClasses.Parameter(1, StorageClass="Calibration", DataType="boolean", Min=0, Max=1, Unit="1")  % Signal override enable